# Grasshopper definition assigment 3 roof Jeffrey Song.gh (Grasshopper 1.0.7)
# plug-ins: Bifocals, Kangaroo2 Components

data_input = DataInput(
    Destination="C:\Users\admin\Desktop\Inpu.ghdata",
    RelativePath="C:\Users\admin\Desktop\Inpu.ghdata|Inpu.ghdata",
    UpdateDelay=50000)  # -> message, footprint, boundary, f2f_heights, roads, roads_data, location, context, context_data
number_slider = Slider(1, range=0..10)
curve = Curve(data_input.boundary)
unit_z = UnitZ(Factor=number_slider)
unit_z_2 = UnitZ(Factor=number_slider)
move = Move(Geometry=curve, Motion=unit_z)  # -> Geometry, Transform
extrude = Extrude(Base=curve, Direction=unit_z_2)
curve_2 = Curve(move.Geometry)
length = Length(Curve=curve_2)
division = Division(A=length, B=Slider(1, range=0..1))
divide_curve = DivideCurve(Curve=curve_2, Count=division, Kinks=False)  # -> Points, Tangents, Parameters
voronoi = Voronoi(Points=divide_curve.Points, BruteForceOverride=False)
explode = Explode(Curve=voronoi, Recursive=True)  # -> Segments, Vertices
removeduplicatelines = RemoveDuplicateLines(Lines=flatten(explode.Segments), Tolerance=0.01)  # -> graft(UniqueLines)
end_points = EndPoints(Curve=removeduplicatelines)  # -> Start, End
point_in_curve = PointInCurve(Point=[end_points.Start, end_points.End], Curve=curve_2)  # -> Relationship, Point
mass_multiplication = MassMultiplication(Input=point_in_curve.Relationship)  # -> Result, PartialResults
dispatch = Dispatch(List=removeduplicatelines, DispatchPattern=mass_multiplication.Result)  # -> ListA, ListB
geometry = Geometry(flatten(dispatch.ListA))
join_curves = JoinCurves(Curves=geometry, Preserve=False)
multiple_curves = MultipleCurves(Curves=join_curves)  # -> Points, IndexA, IndexB, ParamA, ParamB
end_points_2 = EndPoints(Curve=join_curves)  # -> Start, End
delaunay_edges = DelaunayEdges(Points=multiple_curves.Points, Plane=PlaneXY(0, 0, 0))  # -> Connectivity, Edges
curve_curve = CurveCurve(CurveA=delaunay_edges.Edges, CurveB=curve_2)  # -> Points, ParamsA, ParamsB
list_item = ListItem(List=curve_curve.Points, Index=0, Wrap=True)
dispatch_2 = Dispatch(List=graft(delaunay_edges.Edges), DispatchPattern=list_item)  # -> ListA, ListB
geometry_2 = Geometry(flatten(dispatch_2.ListB))
length_2 = Length(Curve=geometry_2)

explode_2 = Explode(Curve=curve_2, Recursive=True)  # -> Segments, Vertices
list_item_2 = ListItem(List=explode_2.Segments, Index=Slider(7, range=0..10), Wrap=True)
length_3 = Length(Curve=list_item_2)
division_2 = Division(A=length_3, B=Slider(2, range=0..10))

average = Average(Input=length_2)
larger_than = LargerThan(FirstNumber=length_2, SecondNumber=average)  # -> LargerThan, OrEqualTo
dispatch_3 = Dispatch(List=geometry_2, DispatchPattern=larger_than.LargerThan)  # -> ListA, ListB
number_slider_2 = Slider(2.559, range=0..10)
geometry_3 = Geometry(dispatch_3.ListA)
tangent = Tangent(Value=degrees(Slider(30, range=0..100)))
extend_curve = ExtendCurve(Curve=geometry_3, Type=0, Start=number_slider_2, End=number_slider_2)
multiplication = Multiplication(A=division_2, B=tangent)

explode_3 = Explode(Curve=curve_2, Recursive=True)  # -> Segments, Vertices
list_item_3 = ListItem(List=explode_3.Vertices, Index=Slider(3, range=0..10), Wrap=True)

explode_4 = Explode(Curve=curve_2, Recursive=True)  # -> Segments, Vertices
list_item_4 = ListItem(List=explode_4.Vertices, Index=Slider(4, range=0..10), Wrap=True)
list_item_5 = ListItem(List=explode_4.Vertices, Index=Slider(5, range=0..10), Wrap=True)

explode_5 = Explode(Curve=curve_2, Recursive=True)  # -> Segments, Vertices
list_item_6 = ListItem(List=explode_5.Vertices, Index=Slider(4, range=0..10), Wrap=True)

curve_3 = Curve(extend_curve)
unit_z_3 = UnitZ(Factor=multiplication)

explode_6 = Explode(Curve=curve_2, Recursive=True)  # -> Segments, Vertices
list_item_7 = ListItem(List=explode_6.Vertices, Index=Slider(6, range=0..10), Wrap=True)

explode_7 = Explode(Curve=curve_2, Recursive=True)  # -> Segments, Vertices
list_item_8 = ListItem(List=explode_7.Vertices, Index=Slider(2, range=0..10), Wrap=True)

move_2 = Move(Geometry=curve_3, Motion=unit_z_3)  # -> Geometry, Transform

geometry_4 = Geometry(move_2.Geometry)
explode_8 = Explode(Curve=geometry_4, Recursive=True)  # -> Segments, flatten(Vertices)
list_item_9 = ListItem(List=explode_8.Vertices, Index=Slider(4, range=0..10), Wrap=True)

explode_9 = Explode(Curve=geometry_4, Recursive=True)  # -> Segments, flatten(Vertices)
list_item_10 = ListItem(List=explode_9.Vertices, Index=Slider(7, range=0..10), Wrap=True)

explode_10 = Explode(Curve=curve_2, Recursive=True)  # -> Segments, Vertices
list_item_11 = ListItem(List=explode_10.Vertices, Index=Slider(7, range=0..10), Wrap=True)
list_item_12 = ListItem(List=explode_10.Vertices, Index=Slider(8, range=0..10), Wrap=True)

explode_11 = Explode(Curve=move_2.Geometry, Recursive=True)  # -> Segments, flatten(Vertices)
list_item_13 = ListItem(List=explode_7.Vertices, Index=Slider(1, range=0..1), Wrap=True)
list_item_14 = ListItem(List=explode_11.Vertices, Index=0, Wrap=True)
list_item_15 = ListItem(List=explode_11.Vertices, Index=Slider(3, range=0..10), Wrap=True)

point = Point(list_item_4)
point_2 = Point(list_item_5)
point_3 = Point(list_item_10)

point_4 = Point(list_item_9)
point_5 = Point(list_item_10)
point_6 = Point(list_item_7)
point_7 = Point(list_item_5)

point_8 = Point(list_item_10)
point_9 = Point(list_item_9)
point_10 = Point(list_item_6)
point_11 = Point(list_item_3)

point_12 = Point(list_item_15)
point_13 = Point(list_item_7)
point_14 = Point(list_item_11)
point_15 = Point(list_item_9)

point_16 = Point(list_item_12)
point_17 = Point(list_item_15)
point_18 = Point(list_item_11)

point_19 = Point(list_item_9)

point_20 = Point(list_item_3)
point_21 = Point(list_item_14)
point_22 = Point(list_item_8)

point_23 = Point(list_item_13)
point_24 = Point(list_item_14)
point_25 = Point(list_item_12)
point_26 = Point(list_item_15)

point_27 = Point(list_item_8)
point_28 = Point(list_item_13)
point_29 = Point(list_item_14)

merge = Merge(Data1=flatten(point_17), Data2=flatten(point_18), Data3=flatten(point_16))
merge_2 = Merge(Data1=flatten(point_29), Data2=flatten(point_27), Data3=flatten(point_28))
merge_3 = Merge(Data1=flatten(point_26), Data2=flatten(point_25), Data3=flatten(point_24), Data4=flatten(point_23))
merge_4 = Merge(Data1=flatten(point), Data2=flatten(point_2), Data3=flatten(point_3))
_4point_surface = _4PointSurface(CornerA=point_4, CornerB=point_5, CornerC=point_7, CornerD=point_6)
_4point_surface_2 = _4PointSurface(CornerA=point_12, CornerB=point_14, CornerC=point_13, CornerD=point_15)
_4point_surface_3 = _4PointSurface(CornerA=point_19, CornerB=point_21, CornerC=point_22, CornerD=point_20)
_4point_surface_4 = _4PointSurface(CornerA=point_11, CornerB=point_10, CornerC=point_8, CornerD=point_9)
polyline = PolyLine(Vertices=merge_2, Closed=point_28)
polyline_2 = PolyLine(Vertices=merge_4, Closed=point_28)
polyline_3 = PolyLine(Vertices=merge_3, Closed=point_23)
polyline_4 = PolyLine(Vertices=merge, Closed=point_16)
boundary_surfaces = BoundarySurfaces(Edges=polyline)
boundary_surfaces_2 = BoundarySurfaces(Edges=polyline_2)
boundary_surfaces_3 = BoundarySurfaces(Edges=polyline_3)
boundary_surfaces_4 = BoundarySurfaces(Edges=polyline_4)
geometry_5 = Geometry(extrude)
merge_5 = Merge(
    Data1=boundary_surfaces_2,
    Data2=_4point_surface,
    Data3=_4point_surface_4,
    Data4=_4point_surface_3,
    Data5=geometry_5,
    Data6=_4point_surface_2,
    Data7=boundary_surfaces_3,
    Data8=boundary_surfaces_4,
    Data9=boundary_surfaces)
brep = Brep(merge_5)

surface = Surface(_4point_surface)

surface_2 = Surface(_4point_surface_4)

custom_preview = CustomPreview(Geometry=brep, Material=ColourSwatch(SwatchColor=RGB(79, 59, 35)))

box = Box(surface)
deconstruct_brep = DeconstructBrep(Brep=box)  # -> Faces, Edges, Vertices
area = Area(Geometry=box)  # -> Area, Centroid
unit_z_4 = UnitZ(Factor=Slider(1.43, range=0..10))
list_item_16 = ListItem(List=deconstruct_brep.Edges, Index=Slider(1, range=0..10), Wrap=True)
contour = Contour(Shape=surface, Point=area.Centroid, Direction=list_item_16, Distance=Slider(5.05, range=0..10))
negative = Negative(Value=unit_z_4)
move_3 = Move(Geometry=contour, Motion=negative)  # -> Geometry, Transform
end_points_3 = EndPoints(Curve=contour)  # -> Start, End
loft = Loft(
    Curves=[contour, move_3.Geometry],
    Options={Adjust=False, Closed=False, LoftEnds=0, LoftSimp=0, LoftType=0, Rebuild=10, Refit=0.01})
move_4 = Move(Geometry=end_points_3.End, Motion=negative)  # -> Geometry, Transform
divide_domain² = DivideDomain²(Domain=loft, UCount=Slider(1, range=0..1), VCount=Slider(6, range=1..20))
project = Project(Geometry=move_4.Geometry, Plane=PlaneXY(0, 0, 0))  # -> Geometry, Transform
isotrim = Isotrim(Surface=loft, Domain=divide_domain²)
offset_curve = OffsetCurve(Curve=isotrim, Distance=Slider(0, range=0..100), Plane=isotrim, Corners=1)
line = Line(StartPoint=project.Geometry, EndPoint=move_4.Geometry)
fillet = Fillet(Curve=offset_curve, Radius=Slider(2, range=0..10))
region_difference = RegionDifference(CurvesA=graft(isotrim), CurvesB=graft(fillet))
boundary_surfaces_5 = BoundarySurfaces(Edges=region_difference)
brep_join = BrepJoin(Breps=boundary_surfaces_5)  # -> Breps, Closed
division_3 = Division(A=Slider(0.304, range=0..2), B=2)
pipe = Pipe(Curve=line, Radius=division_3, Caps=0)
amplitude = Amplitude(Vector=brep_join.Breps, Amplitude=division_3)
multiplication_2 = Multiplication(A=amplitude, B=2)
move_5 = Move(Geometry=brep_join.Breps, Motion=amplitude)  # -> Geometry, Transform
negative_2 = Negative(Value=multiplication_2)
extrude_2 = Extrude(Base=move_5.Geometry, Direction=negative_2)

surface_3 = Surface(boundary_surfaces_3)

surface_4 = Surface(_4point_surface_3)

box_2 = Box(surface_2)
deconstruct_brep_2 = DeconstructBrep(Brep=box_2)  # -> Faces, Edges, Vertices
area_2 = Area(Geometry=box_2)  # -> Area, Centroid
unit_z_5 = UnitZ(Factor=Slider(1.43, range=0..10))
list_item_17 = ListItem(List=deconstruct_brep_2.Edges, Index=Slider(2, range=0..10), Wrap=True)
contour_2 = Contour(Shape=surface_2, Point=area_2.Centroid, Direction=list_item_17, Distance=Slider(5.05, range=0..10))
negative_3 = Negative(Value=unit_z_5)
move_6 = Move(Geometry=contour_2, Motion=negative_3)  # -> Geometry, Transform
end_points_4 = EndPoints(Curve=contour_2)  # -> Start, End
loft_2 = Loft(
    Curves=[contour_2, move_6.Geometry],
    Options={Adjust=False, Closed=False, LoftEnds=0, LoftSimp=0, LoftType=0, Rebuild=10, Refit=0.01})
move_7 = Move(Geometry=end_points_4.End, Motion=negative_3)  # -> Geometry, Transform
divide_domain²_2 = DivideDomain²(Domain=loft_2, UCount=Slider(1, range=0..1), VCount=Slider(6, range=1..20))
project_2 = Project(Geometry=move_7.Geometry, Plane=PlaneXY(0, 0, 0))  # -> Geometry, Transform
isotrim_2 = Isotrim(Surface=loft_2, Domain=divide_domain²_2)
offset_curve_2 = OffsetCurve(Curve=isotrim_2, Distance=Slider(0, range=0..100), Plane=isotrim_2, Corners=1)
line_2 = Line(StartPoint=project_2.Geometry, EndPoint=move_7.Geometry)
fillet_2 = Fillet(Curve=offset_curve_2, Radius=Slider(2, range=0..10))
region_difference_2 = RegionDifference(CurvesA=graft(isotrim_2), CurvesB=graft(fillet_2))
boundary_surfaces_6 = BoundarySurfaces(Edges=region_difference_2)
brep_join_2 = BrepJoin(Breps=boundary_surfaces_6)  # -> Breps, Closed
division_4 = Division(A=Slider(0.304, range=0..2), B=2)
pipe_2 = Pipe(Curve=line_2, Radius=division_4, Caps=0)
amplitude_2 = Amplitude(Vector=brep_join_2.Breps, Amplitude=division_4)
multiplication_3 = Multiplication(A=amplitude_2, B=2)
move_8 = Move(Geometry=brep_join_2.Breps, Motion=amplitude_2)  # -> Geometry, Transform
negative_4 = Negative(Value=multiplication_3)
extrude_3 = Extrude(Base=move_8.Geometry, Direction=negative_4)

box_3 = Box(surface_3)
deconstruct_brep_3 = DeconstructBrep(Brep=box_3)  # -> Faces, Edges, Vertices
area_3 = Area(Geometry=box_3)  # -> Area, Centroid
unit_z_6 = UnitZ(Factor=Slider(1.43, range=0..10))
list_item_18 = ListItem(List=deconstruct_brep_3.Edges, Index=Slider(1, range=0..10), Wrap=True)
contour_3 = Contour(Shape=surface_3, Point=area_3.Centroid, Direction=list_item_18, Distance=Slider(7.25, range=0..10))
negative_5 = Negative(Value=unit_z_6)
move_9 = Move(Geometry=contour_3, Motion=negative_5)  # -> Geometry, Transform
end_points_5 = EndPoints(Curve=contour_3)  # -> Start, End
loft_3 = Loft(
    Curves=[contour_3, move_9.Geometry],
    Options={Adjust=False, Closed=False, LoftEnds=0, LoftSimp=0, LoftType=0, Rebuild=10, Refit=0.01})
move_10 = Move(Geometry=end_points_5.End, Motion=negative_5)  # -> Geometry, Transform
divide_domain²_3 = DivideDomain²(Domain=loft_3, UCount=Slider(1, range=0..1), VCount=Slider(6, range=1..20))
project_3 = Project(Geometry=move_10.Geometry, Plane=PlaneXY(0, 0, 0))  # -> Geometry, Transform
isotrim_3 = Isotrim(Surface=loft_3, Domain=divide_domain²_3)
offset_curve_3 = OffsetCurve(Curve=isotrim_3, Distance=Slider(0, range=0..100), Plane=isotrim_3, Corners=1)
line_3 = Line(StartPoint=project_3.Geometry, EndPoint=move_10.Geometry)
fillet_3 = Fillet(Curve=offset_curve_3, Radius=Slider(2, range=0..10))
region_difference_3 = RegionDifference(CurvesA=graft(isotrim_3), CurvesB=graft(fillet_3))
boundary_surfaces_7 = BoundarySurfaces(Edges=region_difference_3)
brep_join_3 = BrepJoin(Breps=boundary_surfaces_7)  # -> Breps, Closed
division_5 = Division(A=Slider(0.304, range=0..2), B=2)
pipe_3 = Pipe(Curve=line_3, Radius=division_5, Caps=0)
amplitude_3 = Amplitude(Vector=brep_join_3.Breps, Amplitude=division_5)
multiplication_4 = Multiplication(A=amplitude_3, B=2)
move_11 = Move(Geometry=brep_join_3.Breps, Motion=amplitude_3)  # -> Geometry, Transform
negative_6 = Negative(Value=multiplication_4)
extrude_4 = Extrude(Base=move_11.Geometry, Direction=negative_6)

box_4 = Box(surface_4)
deconstruct_brep_4 = DeconstructBrep(Brep=box_4)  # -> Faces, Edges, Vertices
area_4 = Area(Geometry=box_4)  # -> Area, Centroid
unit_z_7 = UnitZ(Factor=Slider(1.43, range=0..10))
list_item_19 = ListItem(List=deconstruct_brep_4.Edges, Index=Slider(2, range=0..10), Wrap=True)
contour_4 = Contour(Shape=surface_4, Point=area_4.Centroid, Direction=list_item_19, Distance=Slider(7.25, range=0..10))
negative_7 = Negative(Value=unit_z_7)
move_12 = Move(Geometry=contour_4, Motion=negative_7)  # -> Geometry, Transform
end_points_6 = EndPoints(Curve=contour_4)  # -> Start, End
loft_4 = Loft(
    Curves=[contour_4, move_12.Geometry],
    Options={Adjust=False, Closed=False, LoftEnds=0, LoftSimp=0, LoftType=0, Rebuild=10, Refit=0.01})
move_13 = Move(Geometry=end_points_6.End, Motion=negative_7)  # -> Geometry, Transform
divide_domain²_4 = DivideDomain²(Domain=loft_4, UCount=Slider(1, range=0..1), VCount=Slider(6, range=1..20))
project_4 = Project(Geometry=move_13.Geometry, Plane=PlaneXY(0, 0, 0))  # -> Geometry, Transform
isotrim_4 = Isotrim(Surface=loft_4, Domain=divide_domain²_4)
offset_curve_4 = OffsetCurve(Curve=isotrim_4, Distance=Slider(0, range=0..100), Plane=isotrim_4, Corners=1)
line_4 = Line(StartPoint=project_4.Geometry, EndPoint=move_13.Geometry)
fillet_4 = Fillet(Curve=offset_curve_4, Radius=Slider(2, range=0..10))
region_difference_4 = RegionDifference(CurvesA=graft(isotrim_4), CurvesB=graft(fillet_4))
boundary_surfaces_8 = BoundarySurfaces(Edges=region_difference_4)
brep_join_4 = BrepJoin(Breps=boundary_surfaces_8)  # -> Breps, Closed
division_6 = Division(A=Slider(0.304, range=0..2), B=2)
pipe_4 = Pipe(Curve=line_4, Radius=division_6, Caps=0)
amplitude_4 = Amplitude(Vector=brep_join_4.Breps, Amplitude=division_6)
multiplication_5 = Multiplication(A=amplitude_4, B=2)
move_14 = Move(Geometry=brep_join_4.Breps, Motion=amplitude_4)  # -> Geometry, Transform
negative_8 = Negative(Value=multiplication_5)
extrude_5 = Extrude(Base=move_14.Geometry, Direction=negative_8)

surface_5 = Surface(_4point_surface_2)

box_5 = Box(surface_5)
deconstruct_brep_5 = DeconstructBrep(Brep=box_5)  # -> Faces, Edges, Vertices
area_5 = Area(Geometry=box_5)  # -> Area, Centroid
unit_z_8 = UnitZ(Factor=Slider(1.43, range=0..10))
list_item_20 = ListItem(List=deconstruct_brep_5.Edges, Index=Slider(1, range=0..10), Wrap=True)
contour_5 = Contour(Shape=surface_5, Point=area_5.Centroid, Direction=list_item_20, Distance=Slider(7.25, range=0..10))
negative_9 = Negative(Value=unit_z_8)
move_15 = Move(Geometry=contour_5, Motion=negative_9)  # -> Geometry, Transform
end_points_7 = EndPoints(Curve=contour_5)  # -> Start, End
loft_5 = Loft(
    Curves=[contour_5, move_15.Geometry],
    Options={Adjust=False, Closed=False, LoftEnds=0, LoftSimp=0, LoftType=0, Rebuild=10, Refit=0.01})
move_16 = Move(Geometry=end_points_7.End, Motion=negative_9)  # -> Geometry, Transform
divide_domain²_5 = DivideDomain²(Domain=loft_5, UCount=Slider(1, range=0..1), VCount=Slider(6, range=1..20))
project_5 = Project(Geometry=move_16.Geometry, Plane=PlaneXY(0, 0, 0))  # -> Geometry, Transform
isotrim_5 = Isotrim(Surface=loft_5, Domain=divide_domain²_5)
offset_curve_5 = OffsetCurve(Curve=isotrim_5, Distance=Slider(0, range=0..100), Plane=isotrim_5, Corners=1)
line_5 = Line(StartPoint=project_5.Geometry, EndPoint=move_16.Geometry)
fillet_5 = Fillet(Curve=offset_curve_5, Radius=Slider(2, range=0..10))
region_difference_5 = RegionDifference(CurvesA=graft(isotrim_5), CurvesB=graft(fillet_5))
boundary_surfaces_9 = BoundarySurfaces(Edges=region_difference_5)
brep_join_5 = BrepJoin(Breps=boundary_surfaces_9)  # -> Breps, Closed
division_7 = Division(A=Slider(0.304, range=0..2), B=2)
pipe_5 = Pipe(Curve=line_5, Radius=division_7, Caps=0)
amplitude_5 = Amplitude(Vector=brep_join_5.Breps, Amplitude=division_7)
multiplication_6 = Multiplication(A=amplitude_5, B=2)
move_17 = Move(Geometry=brep_join_5.Breps, Motion=amplitude_5)  # -> Geometry, Transform
negative_10 = Negative(Value=multiplication_6)
extrude_6 = Extrude(Base=move_17.Geometry, Direction=negative_10)

merge_6 = Merge(Data1=extrude_4, Data2=extrude_5, Data3=extrude_6, Data4=extrude_2, Data5=extrude_3)
Z = UnitZ(Factor=Slider(22, range=20..42))
Z_2 = UnitZ(Factor=Slider(22, range=0..100))

move_18 = Move(Geometry=merge_6, Motion=Z_2)  # -> Geometry, Transform
move_19 = Move(Geometry=brep, Motion=Z)  # -> Geometry, Transform

output = DataOutput(
    Trusses=move_18.Geometry,
    Roof_Surface=move_19.Geometry,
    Destination="C:\Users\admin\Dropbox\CODE2120\Roof Jeffrey.ghdata",
    RelativePath="C:\Users\admin\Dropbox\CODE2120\Roof Jeffrey.ghdata|..\Dropbox\CODE2120\Roof Jeffrey.ghdata")
